# Grasshopper definition 241014_ FRTN80_group1_GH_v1.gh (Grasshopper 1.0.8)
# plug-ins: RhinoCodePluginGH, Pufferfish

number_slider = Slider(18, range=0..100)
crv = Curve(<curve referenced from the Rhino model>)
fillet = Fillet(Curve=crv, Radius=Slider(100, range=0..100))
crv_2 = Curve(fillet)

# ---- group: waves manipulation
hframes = HorizontalFrames(Curve=crv_2, Count=Slider(18, range=0..30))  # -> Frames, Parameters
sift = SiftPattern(List=hframes.Frames, SiftPattern=[0, 1])  # -> Output0, Output1
neg = Negative(Value=number_slider)
pt = PointOriented(BasePlane=sift.Output0, UComponent=0, VComponent=number_slider, WComponent=0)
pt_2 = PointOriented(BasePlane=sift.Output1, UComponent=0, VComponent=neg, WComponent=0)
combine = CombineData(Input0=pt, Input1=pt_2)  # -> Result, Index
intcrv = Interpolate(Vertices=combine.Result, Degree=3, Periodic=False, KnotStyle=1)  # -> Curve, Length, Domain

# ----
crv_3 = Curve(intcrv.Curve)
crv_4 = Curve(crv_3)

xy = XYPlane(Origin=Point(0, 0, 0))
brec = BoundingRectangle(Geometry=crv_4, Plane=xy, Axis=0, Slide=0, Union=True)  # -> Bounding, DimensionX, DimensionY
debrep = DeconstructBrep(Brep=brec.Bounding)  # -> Faces, Edges, Vertices
item = ListItem(List=debrep.Edges, Index="4", Wrap=True)
item_2 = ListItem(List=debrep.Edges, Index="2", Wrap=True)
line = Line(item)
crv_5 = Curve(item_2)
midpt = CurveMiddle(Curve=line)
midpt_2 = CurveMiddle(Curve=crv_5)
brep = Brep(brec.Bounding)
number_slider_2 = Slider(80, range=0..100)
X = UnitX(Factor=1)
xz = XZPlane(Origin=midpt)
X_2 = UnitX(Factor=1)
rot3d = Rotate3D(Geometry=brep, Angle=degrees(Slider(40, range=0..100)), Center=midpt, Axis=X)  # -> Geometry, Transform
rot3d_2 = Rotate3D(Geometry=crv_4, Angle=degrees(Slider(80, range=0..100)), Center=midpt, Axis=X_2)  # -> Geometry, Transform
rot3d_3 = Rotate3D(Geometry=brep, Angle=degrees(number_slider_2), Center=midpt, Axis=X)  # -> Geometry, Transform
debrep_2 = DeconstructBrep(Brep=rot3d.Geometry)  # -> Faces, Edges, Vertices
arc = Arc(Plane=xz, Radius=Slider(319, range=0..1000), Angle=number_slider_2)  # -> Arc, Length
edges = BrepEdges(Brep=rot3d_3.Geometry)  # -> Naked, Interior, NonManifold
item_3 = ListItem(List=debrep_2.Edges, Index="2", Wrap=True)
item_4 = ListItem(List=edges.Naked, Index="2", Wrap=True)
midpt_3 = CurveMiddle(Curve=item_4)
midpt_4 = CurveMiddle(Curve=item_3)
pt_3 = Point(midpt_4)
pt_4 = Point(midpt_3)
pt_5 = Point(midpt_2)
arc_2 = Arc3Pt(PointA=pt_4, PointB=pt_3, PointC=pt_5)  # -> Arc, Plane, Radius
arc_3 = CircularArc(arc_2.Arc)

Y = UnitY(Factor=Slider(90, range=0..100))
move = Move(Geometry=pt_3, Motion=Y)  # -> Geometry, Transform

# ---- group: number of sections
arrcurve = CurveArray(Geometry=rot3d_2.Geometry, Curve=arc_3, Count=Slider(160, range=0..200))  # -> Geometry, Transform

# ---- group: sections
crv_6 = Curve(arrcurve.Geometry)
py3 = Python3Script(curves=crv_6)  # -> put, moved_curves; inputs curves: list of Curve
# ---------- py3: Python ----------
import Rhino.Geometry as rg
import random
import rhinoscriptsyntax as rs
import sys
import Rhino
import pip
from Rhino import RhinoMath

import Rhino.Geometry as rg

def move_curves(curves, distance):
    moved_curves = []
    for i, curve in enumerate(curves):
        translation = rg.Vector3d(0, distance * (i + 1), 0)
        moved_curve = curve.Duplicate()
        moved_curve.Translate(translation)
        moved_curves.append(moved_curve)
    return moved_curves

# This part you set up within Grasshopper with the correct input component:
distance = 0.3  # 10 mm
moved_curves = move_curves(curves, distance)

# Output the moved curves to Grasshopper
moved_curves  # Connect this output to a Geometry parameter in Grasshopper
# ---------- end py3 ----------
crv_7 = Curve(py3.moved_curves)
loft = Loft(Curves=crv_7, Options={Adjust=False, Closed=False, LoftEnds=0, LoftSimp=0, LoftType=0, Rebuild=10, Refit=0.01})

# ----
crv_8 = Curve(crv_7)

# ---- group: not important
item_5 = ListItem(List=crv_8, Index="7", Wrap=True)
item_6 = ListItem(List=crv_8, Index="19", Wrap=True)
item_7 = ListItem(List=crv_8, Index="0", Wrap=True)
rebcrv = RebuildCurve(Curve=item_7, Count=Slider(16, range=0..100), EndTangents=False)
rebcrv_2 = RebuildCurve(Curve=item_5, Count=Slider(21, range=0..100), EndTangents=False)
loft_2 = Loft(Curves=rebcrv, Options={Adjust=False, Closed=False, LoftEnds=0, LoftSimp=0, LoftType=0, Rebuild=10, Refit=0.01})
brec_2 = BoundingRectangle(Geometry=item_6, Plane=PlaneXY(0, 0, 0), Axis=0, Slide=0, Union=True)  # -> Bounding, DimensionX, DimensionY
debrep_3 = DeconstructBrep(Brep=brec_2.Bounding)  # -> Faces, Edges, Vertices
item_8 = ListItem(List=debrep_3.Edges, Index="2", Wrap=True)
midpt_5 = CurveMiddle(Curve=item_8)
pt_6 = Point(pt_4)
pt_7 = Point(move.Geometry)
pt_8 = Point(midpt_5)
arc_4 = Arc3Pt(PointA=pt_6, PointB=pt_7, PointC=pt_8)  # -> Arc, Plane, Radius
swp1 = Sweep1(Rail=arc_4.Arc, Sections=[rebcrv, rebcrv_2, item_6], Miter=1)

# ----
simplify = SimplifyCurve(Curve=item_7)  # -> Curve, Simplified
divdist = DivideDistance(Curve=crv_7, Distance=Slider(12, range=0..20))  # -> Points, Tangents, Parameters
flip = FlipMatrix(Data=divdist.Points)
shift = ShiftList(List=flip, Shift=1, Wrap=True)
vec2pt = Vector2Pt(PointA=flip, PointB=shift, Unitize=False)  # -> Vector, Length

# ----
# Fix last frame
Z = UnitZ(Factor=1)
neg_2 = Negative(Value=Z)
replace = ReplaceItems(List=vec2pt.Vector, Item=neg_2, Indices="-1", Wrap=True)

flip_2 = FlipMatrix(Data=replace)

# ---- group: frames
pl = PlaneNormal(Origin=divdist.Points, ZAxis=flip_2)

# ----
# Is travel point
boolean = Boolean([True, False, False, False, False, True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])
# Points
point = Point(pl)
value_list = ValueList({"v5", "v10", "v20", "v30", "v40", "v50", "v60", "v80", "v100", "v150", "v200", "v300", "v400", "v500", "v600", "v800", "v1000", "v1500", "v2000", "v2500", "v3000", "v4000", "v5000", "v6000", "v7000", "vmax"}, selected="v5")
merge = Merge(
    Data1=Slider(0, range=-360..360),
    Data2=Slider(0, range=-360..360),
    Data3=Slider(0, range=-360..360),
    Data4=Slider(0, range=-360..360),
    Data5=Slider(0, range=-360..360),
    Data6=Slider(0, range=-360..360))
construct_plane = ConstructPlane(Origin=point, XAxis=Vector(1, 0, 0), YAxis=Vector(0, 1, 0))
file_path = FilePath("C:\Users\240826_HQ\Desktop\Semester 3_240902-240119\Applied Robotics for Architects - FRTN80\3d printer set up\rapid")
flip_plane = FlipPlane(Plane=construct_plane, ReverseX=False, ReverseY=False, SwapAxes=True)
lng = ListLength(List=flip_plane)
repeat = RepeatData(Data=Toggle(False), Length=lng)
ghpython_script = GhPythonScript(
    planes=simplify(flip_plane),
    is_travel_point=simplify(repeat),
    start_configuration=merge,
    wobj_name="ob_RRC_workplace",
    print_speed_value=value_list)  # -> out, rapid; inputs planes: tree, is_travel_point: tree, start_configuration: list
# ---------- ghpython_script: Python ----------
import Rhino.Geometry as rg

from ghpythonlib.treehelpers import tree_to_list


EXT_AXES = "[9E9,9E9,9E9,9E9,9E9,9E9]"

def rg_plane_to_posdata(plane):
    x, y, z = plane.Origin
    
    posdata = "[[{:.1f}, {:.1f}, {:.1f}],".format(x, y, z)
    
    q = rg.Quaternion.Rotation(rg.Plane.WorldXY, plane)
    
    posdata += "[{:.4f}, {:.4f}, {:.4f}, {:.4f}],".format(q.A, q.B, q.C, q.D)
    posdata += "[0,0,0,0],{}]".format(EXT_AXES)
    
    return posdata

if wobj_name is None:
    wobj_name = "wobj0"
if tool_name is None:
    tool_name = "tool0"

if start_configuration is None:
    start_configuration = [0, 0, 0, 0, 0, 0]

heater_on = "DO_1"
stepper_on = "DO_10"

if print_speed_value is None:
    print_speed_value = "s_printSpeed"

TRAVEL_SPEED_VALUE = "v300"

PRINT_SPEED_NAME = "s_printSpeed"
TRAVEL_SPEED_NAME = "s_travelSpeed"

module_level_vars = """VAR speeddata {}:={};
    VAR speeddata {}:={};
""".format(PRINT_SPEED_NAME, print_speed_value, TRAVEL_SPEED_NAME, TRAVEL_SPEED_VALUE)


main_proc = """PROC main()
        IF RobOS() = FALSE THEN
            {} := vmax; ! run at max speed in robotstudio
            {} := vmax;
        ENDIF
        print;
    ENDPROC
""".format(TRAVEL_SPEED_NAME, PRINT_SPEED_NAME)

extrude10sec_proc = """PROC Extrude10Sec ()
        SetDO {}, 1;
        SetDO\SDelay:=10, {}, 0;
    ENDPROC
""".format(stepper_on, stepper_on)

layers = tree_to_list(planes, retrieve_base=None)
is_travel_point_layer = tree_to_list(is_travel_point, retrieve_base=None)

home_joint_pos = "[" + ",".join([str(c) for c in start_configuration]) + "]"

move_abs_j_start = "MoveAbsJ [{}, {}], {}, fine, tool0;".format(home_joint_pos,EXT_AXES,TRAVEL_SPEED_NAME)
move_j_start = "MoveJ {}, {}, fine, {}, \WObj:={};".format(rg_plane_to_posdata(layers[0][0]), 
                                                           TRAVEL_SPEED_NAME, 
                                                           tool_name, 
                                                           wobj_name)
rapid = """MODULE fdm_print
    {}
    {}
    {}
    PROC print()
        {}
        SetDO {}, 1; ! heater on
        TPWrite "Press play when extruder is at right temperature";
        Stop;
        {}
""".format(module_level_vars, 
           extrude10sec_proc, 
           main_proc, 
           move_abs_j_start, 
           heater_on,
           move_j_start)


last_is_travel_pt = True
for layer, tp_list in zip(layers, is_travel_point_layer):
    for plane, tp in zip(layer, tp_list):
        new_lines = ""
        if tp:
            if not last_is_travel_pt:
                new_lines = "        SetDO {}, 0; ! stepper on\n".format(stepper_on)
            speed = TRAVEL_SPEED_NAME
        else:
            if last_is_travel_pt:
                new_lines = "        SetDO {}, 1; ! stepper off\n".format(stepper_on)
            speed = PRINT_SPEED_NAME
        posdata = rg_plane_to_posdata(plane)
        new_lines += "        MoveL {}, {}, fine, {}, \WObj:={};".format(posdata, speed, tool_name, wobj_name)
    
        rapid += new_lines + "\n"
        last_is_travel_pt = tp
    rapid += "    ! layer end\n"

rapid += """        SetDO {}, 0; ! stepper off
        SetDO {}, 0; ! heater off
    ENDPROC
ENDMODULE""".format(stepper_on, heater_on)
# ---------- end ghpython_script ----------
ghpython_script_2 = GhPythonScript(contents=ghpython_script.rapid, filepath=file_path, save=Button())  # -> out, a
# ---------- ghpython_script_2: Python ----------
if save:
    with open(filepath, mode="w") as fp:
        fp.write(contents)
# ---------- end ghpython_script_2 ----------
panel = Panel(ghpython_script.rapid)

# ---- group: not important
number_slider_3 = Slider(10, range=0..100)
xy_2 = XYPlane(Origin=Point(0, 0, 0))
neg_3 = Negative(Value=number_slider_3)
offcrv = OffsetCurve(Curve=crv_3, Plane=xy_2, Distance=number_slider_3, BothSides=0, Kinks=0, CapType=1)

# ----
crv_9 = Curve(offcrv)

# ---- group: not important (continued)
fillet_2 = Fillet(Curve=crv_9, Radius="20")
