# Grasshopper definition 241022_ FRTN80_group1_GH_v6_simple_shape.gh (Grasshopper 1.0.8)
# plug-ins: RhinoCodePluginGH, Pufferfish

number_slider = Slider(16, range=0..100)
number_slider_2 = Slider(8, range=0..10)

# ---- group: smaller version
crv = Curve(<curve referenced from the Rhino model>)

# ---- group: waves manipulation
number_slider_3 = Slider(14, range=0..30)
hframes = HorizontalFrames(Curve=crv, Count=Slider(8, range=0..10))  # -> Frames, Parameters
sift = SiftPattern(List=hframes.Frames, SiftPattern=[0, 1])  # -> Output0, Output1
neg = Negative(Value=number_slider_2)
pt = PointOriented(BasePlane=sift.Output0, UComponent=0, VComponent=number_slider_2, WComponent=0)
pt_2 = PointOriented(BasePlane=sift.Output1, UComponent=0, VComponent=neg, WComponent=0)
combine = CombineData(Input0=pt, Input1=pt_2)  # -> Result, Index
intcrv = Interpolate(Vertices=combine.Result, Degree=3, Periodic=False, KnotStyle=1)  # -> Curve, Length, Domain

# ----
crv_2 = Curve(<curve referenced from the Rhino model>)
fillet = Fillet(Curve=crv_2, Radius=Slider(100, range=0..100))
crv_3 = Curve(fillet)
crv_4 = Curve(intcrv.Curve)
crv_5 = Curve(crv_4)

xy = XYPlane(Origin=Point(0, 0, 0))
brec = BoundingRectangle(Geometry=crv_5, Plane=xy, Axis=0, Slide=0, Union=True)  # -> Bounding, DimensionX, DimensionY
debrep = DeconstructBrep(Brep=brec.Bounding)  # -> Faces, Edges, Vertices
item = ListItem(List=debrep.Edges, Index="4", Wrap=True)
item_2 = ListItem(List=debrep.Edges, Index="2", Wrap=True)
line = Line(item)
crv_6 = Curve(item_2)
midpt = CurveMiddle(Curve=line)
midpt_2 = CurveMiddle(Curve=crv_6)
brep = Brep(brec.Bounding)
number_slider_4 = Slider(80, range=0..100)
X = UnitX(Factor=1)
xz = XZPlane(Origin=midpt)
X_2 = UnitX(Factor=1)
rot3d = Rotate3D(Geometry=brep, Angle=degrees(Slider(40, range=0..100)), Center=midpt, Axis=X)  # -> Geometry, Transform
rot3d_2 = Rotate3D(Geometry=crv_5, Angle=degrees(Slider(80, range=0..100)), Center=midpt, Axis=X_2)  # -> Geometry, Transform
rot3d_3 = Rotate3D(Geometry=brep, Angle=degrees(number_slider_4), Center=midpt, Axis=X)  # -> Geometry, Transform
debrep_2 = DeconstructBrep(Brep=rot3d.Geometry)  # -> Faces, Edges, Vertices
arc = Arc(Plane=xz, Radius=Slider(319, range=0..1000), Angle=number_slider_4)  # -> Arc, Length
edges = BrepEdges(Brep=rot3d_3.Geometry)  # -> Naked, Interior, NonManifold
item_3 = ListItem(List=debrep_2.Edges, Index="2", Wrap=True)
item_4 = ListItem(List=edges.Naked, Index="2", Wrap=True)
midpt_3 = CurveMiddle(Curve=item_4)
midpt_4 = CurveMiddle(Curve=item_3)
pt_3 = Point(midpt_4)
pt_4 = Point(midpt_3)
pt_5 = Point(midpt_2)
arc_2 = Arc3Pt(PointA=pt_4, PointB=pt_3, PointC=pt_5)  # -> Arc, Plane, Radius
arc_3 = CircularArc(arc_2.Arc)

number_slider_5 = Slider(80, range=0..100)

# ---- group: number of sections
arrcurve = CurveArray(Geometry=rot3d_2.Geometry, Curve=arc_3, Count=Slider(160, range=0..200))  # -> Geometry, Transform

# ---- group: sections
crv_7 = Curve(arrcurve.Geometry)
py3 = Python3Script(curves=crv_7)  # -> put, moved_curves; inputs curves: list of Curve
# ---------- py3: Python ----------
import Rhino.Geometry as rg
import random
import rhinoscriptsyntax as rs
import sys
import Rhino
import pip
from Rhino import RhinoMath

import Rhino.Geometry as rg

def move_curves(curves, distance):
    moved_curves = []
    for i, curve in enumerate(curves):
        translation = rg.Vector3d(0, distance * (i + 1), 0)
        moved_curve = curve.Duplicate()
        moved_curve.Translate(translation)
        moved_curves.append(moved_curve)
    return moved_curves

# This part you set up within Grasshopper with the correct input component:
distance = 0.3  # 10 mm
moved_curves = move_curves(curves, distance)

# Output the moved curves to Grasshopper
moved_curves  # Connect this output to a Geometry parameter in Grasshopper
# ---------- end py3 ----------
reverse_list = ReverseList(List=py3.moved_curves)
crv_8 = Curve(reverse_list)
loft = Loft(Curves=crv_8, Options={Adjust=False, Closed=False, LoftEnds=0, LoftSimp=0, LoftType=0, Rebuild=10, Refit=0.01})

# ----
divdist = DivideDistance(Curve=crv_8, Distance=Slider(12, range=0..20))  # -> Points, Tangents, Parameters
reverse_list_2 = ReverseList(List=divdist.Points)
value_list = ValueList({"v5", "v10", "v20", "v30", "v40", "v50", "v60", "v80", "v100", "v150", "v200", "v300", "v400", "v500", "v600", "v800", "v1000", "v1500", "v2000", "v2500", "v3000", "v4000", "v5000", "v6000", "v7000", "vmax"}, selected="v5")
merge = Merge(
    Data1=Slider(0, range=-360..360),
    Data2=Slider(0, range=-360..360),
    Data3=Slider(0, range=-360..360),
    Data4=Slider(0, range=-360..360),
    Data5=Slider(0, range=-360..360),
    Data6=Slider(0, range=-360..360))

# ---- group: not important
number_slider_6 = Slider(10, range=0..100)
xy_2 = XYPlane(Origin=Point(0, 0, 0))
neg_2 = Negative(Value=number_slider_6)
offcrv = OffsetCurve(Curve=crv_4, Plane=xy_2, Distance=number_slider_6, BothSides=0, Kinks=0, CapType=1)

# ----
crv_9 = Curve(offcrv)

# ---- group: not important (continued)
fillet_2 = Fillet(Curve=crv_9, Radius="20")

# ----
# Align plane to curve
flip = FlipMatrix(Data=reverse_list_2)
shift = ShiftList(List=flip, Shift=1, Wrap=True)
vec2pt = Vector2Pt(PointA=flip, PointB=shift, Unitize=False)  # -> Vector, Length

# ----
# Fix last frame
panel = Panel("-2")
list_item = ListItem(List=vec2pt.Vector, Index=panel, Wrap=True)
replace = ReplaceItems(List=vec2pt.Vector, Item=list_item, Indices="-1", Wrap=True)

flip_2 = FlipMatrix(Data=replace)

# ---- group: frames
pl = PlaneNormal(Origin=reverse_list_2, ZAxis=flip_2)

# ----
planesrf = PlaneSurface(Plane=pl, XSize=Domain(-10, 10), YSize=Domain(-10, 10))
panel_2 = Panel(pl)
pl_2 = PlaneNormal(Origin=reverse_list_2, ZAxis=planesrf)

# ----
# Is travel point
# Points
point = Point(pl)
boolean = Boolean([True, False, False, False, False, True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])
construct_plane = ConstructPlane(Origin=point, XAxis=Vector(1, 0, 0), YAxis=Vector(0, 1, 0))
file_path = FilePath("C:\Users\240826_HQ\Desktop\Semester 3_240902-240119\Applied Robotics for Architects - FRTN80\3d printer set up\rapid")
ghpython_script = GhPythonScript(filepath=file_path, save=Button())  # -> out, a
# ---------- ghpython_script: Python ----------
if save:
    with open(filepath, mode="w") as fp:
        fp.write(contents)
# ---------- end ghpython_script ----------

# ---- group: the tilted planes
pln = Plane(pl)

# ----
panel_3 = Panel(pln)
lng = ListLength(List=pl)

tree_statistics = TreeStatistics(Tree=pl)  # -> Paths, Length, Count
list_item_2 = ListItem(List=tree_statistics.Paths, Index=Slider(0, range=0..200), Wrap=False)
tree_branch = TreeBranch(Tree=pl, Path=list_item_2, MaintainPaths=True)

repeat = RepeatData(Data=Toggle(False), Length=lng)
panel_4 = Panel(tree_branch)
ghpython_script_2 = GhPythonScript(
    planes=simplify(pl),
    is_travel_point=simplify(repeat),
    start_configuration=merge,
    wobj_name="ob_RRC_workplace",
    print_speed_value=value_list)  # -> out, rapid; inputs planes: tree, is_travel_point: tree, start_configuration: list
# ---------- ghpython_script_2: Python ----------
import Rhino.Geometry as rg

from ghpythonlib.treehelpers import tree_to_list


EXT_AXES = "[9E9,9E9,9E9,9E9,9E9,9E9]"

def rg_plane_to_posdata(plane):
    x, y, z = plane.Origin
    
    posdata = "[[{:.1f}, {:.1f}, {:.1f}],".format(x, y, z)
    
    q = rg.Quaternion.Rotation(rg.Plane.WorldXY, plane)
    
    posdata += "[{:.4f}, {:.4f}, {:.4f}, {:.4f}],".format(q.A, q.B, q.C, q.D)
    posdata += "[0,0,0,0],{}]".format(EXT_AXES)
    
    return posdata

if wobj_name is None:
    wobj_name = "wobj0"
if tool_name is None:
    tool_name = "tool0"

if start_configuration is None:
    start_configuration = [0, 0, 0, 0, 0, 0]

heater_on = "DO_1"
stepper_on = "DO_10"

if print_speed_value is None:
    print_speed_value = "s_printSpeed"

TRAVEL_SPEED_VALUE = "v300"

PRINT_SPEED_NAME = "s_printSpeed"
TRAVEL_SPEED_NAME = "s_travelSpeed"

module_level_vars = """VAR speeddata {}:={};
    VAR speeddata {}:={};
""".format(PRINT_SPEED_NAME, print_speed_value, TRAVEL_SPEED_NAME, TRAVEL_SPEED_VALUE)


main_proc = """PROC main()
        IF RobOS() = FALSE THEN
            {} := vmax; ! run at max speed in robotstudio
            {} := vmax;
        ENDIF
        print;
    ENDPROC
""".format(TRAVEL_SPEED_NAME, PRINT_SPEED_NAME)

extrude10sec_proc = """PROC Extrude10Sec ()
        SetDO {}, 1;
        SetDO\SDelay:=10, {}, 0;
    ENDPROC
""".format(stepper_on, stepper_on)

layers = tree_to_list(planes, retrieve_base=None)
is_travel_point_layer = tree_to_list(is_travel_point, retrieve_base=None)

home_joint_pos = "[" + ",".join([str(c) for c in start_configuration]) + "]"

move_abs_j_start = "MoveAbsJ [{}, {}], {}, fine, tool0;".format(home_joint_pos,EXT_AXES,TRAVEL_SPEED_NAME)
move_j_start = "MoveJ {}, {}, fine, {}, \WObj:={};".format(rg_plane_to_posdata(layers[0][0]), 
                                                           TRAVEL_SPEED_NAME, 
                                                           tool_name, 
                                                           wobj_name)
rapid = """MODULE fdm_print
    {}
    {}
    {}
    PROC print()
        {}
        SetDO {}, 1; ! heater on
        TPWrite "Press play when extruder is at right temperature";
        Stop;
        {}
""".format(module_level_vars, 
           extrude10sec_proc, 
           main_proc, 
           move_abs_j_start, 
           heater_on,
           move_j_start)


last_is_travel_pt = True
for layer, tp_list in zip(layers, is_travel_point_layer):
    for plane, tp in zip(layer, tp_list):
        new_lines = ""
        if tp:
            if not last_is_travel_pt:
                new_lines = "        SetDO {}, 0; ! stepper on\n".format(stepper_on)
            speed = TRAVEL_SPEED_NAME
        else:
            if last_is_travel_pt:
                new_lines = "        SetDO {}, 1; ! stepper off\n".format(stepper_on)
            speed = PRINT_SPEED_NAME
        posdata = rg_plane_to_posdata(plane)
        new_lines += "        MoveL {}, {}, fine, {}, \WObj:={};".format(posdata, speed, tool_name, wobj_name)
    
        rapid += new_lines + "\n"
        last_is_travel_pt = tp
    rapid += "    ! layer end\n"

rapid += """        SetDO {}, 0; ! stepper off
        SetDO {}, 0; ! heater off
    ENDPROC
ENDMODULE""".format(stepper_on, heater_on)
# ---------- end ghpython_script_2 ----------
panel_5 = Panel(ghpython_script_2.rapid)  # disabled
